vi "Main.gviweb"   [G Web Development Software 21.0.0]
panel indicators:
  "value": bool
  "Chart": i32
uses:
  WebApp::Function.gvi
diagram:
  # Place setup code before the loop. For example, perform initial data communication and wire the results into the loop.
  # Top-Level WebVIs usually contain a While Loop that never stops so that they can continue running as long as the web page is open in the user's web browser.
  s1 = FALSE  # shift register
  while (iteration -> i1) {
    Not(x=s1) -> w1
    call "Function.gvi"(x=i1) -> (remainder=w2)
    Is Equal To 0(x=w2) -> w3
    Select(s=w3, t=w1, f=s1) -> w4
    $value <- w4
    $Chart <- w2
    Wait(time to wait=50)
    next s1 = w4
    stop if FALSE
  }
